% Simulink data dictionary analogComputerData.sldd

bus_voltage_measurements = Simulink.Bus()
  V_IC: double, Unit="V"
  V_In: double, Unit="V"
  V_Out: double, Unit="V"

bus_integrator_switches = Simulink.Bus()
  s_IC: double
  s_In: double

bus_integrator_measurements = Simulink.Bus()
  Mode: Enum: enum_int_mode
  V_IC: double
  V_In: double
  V_Out: double

bus_differentiator_measurements = Simulink.Bus()
  V_In: double
  V_Out: double

bus_const_multiplier_measurements = Simulink.Bus()
  V_In: double
  V_Out: double

RTol = 0.01

bus_damped_pendulum_measurements = Simulink.Bus()
  Mode: Enum: enum_int_mode
  V_In: double
  V_Out1: double
  V_Out2: double

bus_step_filter_measurements = Simulink.Bus()
  Mode: Enum: enum_int_mode
  V_In1: double
  V_Out1: double
  V_Out2: double
  V_In2: double